# Grasshopper definition ca.gh (Grasshopper 1.0.7)

pt = Point([<point referenced from the Rhino model> x7])
number_slider = Slider(5, range=0..7)
item = ListItem(List=pt, Index=number_slider, Wrap=True)
devec = DeconstructVector(Vector=item)  # -> XComponent, YComponent, ZComponent
sph = Sphere(Base=pt, Radius=Slider(0.09, range=0..1))
item_2 = ListItem(List=sph, Index=number_slider, Wrap=True)
panel = Panel(devec.XComponent)
panel_2 = Panel(devec.YComponent)
panel_3 = Panel(devec.ZComponent)
